# Grasshopper definition intro_to_cd.gh (Grasshopper 1.0.7)

# 2.3 Data structure
# List
number_slider = Slider(10, range=0..10)
# Data tree
number_slider_2 = Slider(10, range=0..10)
# 2.2 Basics
# Loft
number_slider_3 = Slider(45.1, range=0..100)
series = Series(Start=0, Step=number_slider, Count=Slider(5, range=0..10))
series_2 = Series(Start=0, Step=number_slider_2, Count=Slider(5, range=0..10))
series_3 = Series(Start=0, Step=Slider(10, range=0..10), Count=Slider(5, range=0..10))
polygon = Polygon(Plane="0,0,0", Radius=number_slider_3, Segments=Slider(12, range=3..12), FilletRadius=0)  # -> Polygon, Length
rad = Radians(Degrees=Slider(81.2, range=-90..90))
Z = UnitZ(Factor=Slider(84.3, range=0..100))
graft = GraftTree(Tree=series_2, IncludeEmptyLists=True, IncludeNullItems=True)
panel = Panel(series)
panel_2 = Panel(graft)
pt = ConstructPoint(XCoordinate=series, YCoordinate=0, ZCoordinate=0)  # -> simplify(Point)
pt_2 = ConstructPoint(XCoordinate=graft, YCoordinate=series_3, ZCoordinate=0)  # -> simplify(Point)
move = Move(Geometry=polygon.Polygon, Motion=Z)  # -> Geometry, Transform
xy = XYPlane(Origin="0,0,0")
viewer = ParamViewer(pt)
panel_3 = Panel(pt)
viewer_2 = ParamViewer(pt_2)
panel_4 = Panel(pt_2)
rotate = Rotate(Geometry=move.Geometry, Angle=rad, Plane=xy)  # -> Geometry, Transform
points = PointList(Points=pt, Size="3")
loft = Loft(
    Curves=[polygon.Polygon, rotate.Geometry],
    Options={Adjust=False, Closed=False, LoftEnds=0, LoftSimp=0, LoftType=0, Rebuild=10, Refit=0.01})
points_2 = PointList(Points=pt_2, Size="3")
item = ListItem(List=pt, Index=Slider(0, range=0..10), Wrap=True)
item_2 = ListItem(List=pt_2, Index=Slider(0, range=0..10), Wrap=True)
cir = Circle(Plane=pt, Radius=Slider(6.5, range=0..10))
cir_2 = Circle(Plane=pt_2, Radius=Slider(6, range=0..10))
