# Grasshopper definition Nenkin.gh (Grasshopper 1.0.7)
# plug-ins: Kangaroo2 Components, Weaverbird

# Reverse lightning
number_slider = Slider(10, range=0..10)
xz = XZPlane(Origin=Point(0, 0, 0))
cir = Circle(Plane=PlaneXY(0, 0, 0), Radius=number_slider)
ellipse = Ellipse(Plane=xz, Radius1=Slider(2.5, range=0..10), Radius2=Slider(10, range=0..10))  # -> Ellipse, Focus1, Focus2
bbox = BoundingBox(Content=cir, Plane=PlaneXY(0, 0, 0))  # -> Box, Box_2
graph = GraphMapper(Slider(0.25, range=0..1), x0=0, x1=1, y0=0, y1=1, container_name="Sine", Equation_px=[0, 1], Equation_py=[0, 1])
pop2d = Populate2D(Region=bbox.Box, Count=Slider(300, range=0..5000), Seed=Slider(200, range=0..1000))
eval = EvaluateCurve(Curve=reparameterize(ellipse.Ellipse), Parameter=graph)  # -> Point, Tangent, Angle
incurve = PointInCurve(Point=pop2d, Curve=cir)  # -> Relationship, Point
cull = CullPattern(List=pop2d, CullPattern=incurve.Relationship)
cps = ClosestPoints(Point=graft(cull), Cloud=cull, Count=Slider(5, range=0..10))  # -> ClosestPoint, CPIndex, Distance
vec2pt = Vector2Pt(PointA=eval.Point, PointB=cull, Unitize=False)  # -> Vector, Length
cull_i = CullIndex(List=cps.ClosestPoint, Indices="0", Wrap=True)
vec2pt_2 = Vector2Pt(PointA=graft(cull), PointB=cull_i, Unitize=False)  # -> Vector, Length
angle = Angle(VectorA=graft(vec2pt.Vector), VectorB=vec2pt_2.Vector)  # -> Angle, Reflex
sort = SortList(Keys=angle.Angle, ValuesA=cull_i)  # -> Keys, ValuesA
item = ListItem(List=sort.ValuesA, Index=0, Wrap=True)
ln = Line(StartPoint=graft(cull), EndPoint=item)  # -> flatten(Line)
cir_2 = Circle(Plane=PlaneXY(0, 0, 0), Radius=Slider(11, range=0..20))
mesh = MeshBrep(
    Brep=cir_2,
    Settings={GridMaxCount=0, GridMinCount=16, JaggedSeams=False, MaxEdgeLength=0, MinEdgeLength=0.0001, MinTolerance=0, Refine=True, RefineAngle=0, RelativeTolerance=0.65, SimplePlanes=True, Tolerance=0})
dam = DataDam(DataA=ln, BufferDelay=10000000, BufferMode=0)
triremesh = TriRemesh(Geometry=mesh, Length=Slider(0.3, range=0.1..1), Iterations=25)  # -> Triangulation, Dual, Creases
line = Line(flatten(dam))
dam_2 = DataDam(DataA=ln, BufferDelay=10000000, BufferMode=0)
divlength = DivideLength(Curve=line, Length=Slider(0.1, range=0.1..1))  # -> Points, Tangents, Parameters
demesh = DeconstructMesh(Mesh=triremesh.Triangulation)  # -> Vertices, Faces, Colours, Normals
pull = PullPoint(Point=flatten(demesh.Vertices), Geometry=flatten(divlength.Points), ClosestOnly=True)  # -> ClosestPoint, Distance
vec2pt_3 = Vector2Pt(PointA=demesh.Vertices, PointB=pull.ClosestPoint, Unitize=False)  # -> Vector, Length
xy_threshold = Slider(0.37, range=0..1)
z_threshold = Slider(0.16, range=0..1)
bnd = Bounds(Numbers=vec2pt_3.Length)
remap = RemapNumbers(Value=vec2pt_3.Length, Source=bnd, Target=Domain(0, 1))  # -> Mapped, Clipped
remap_2 = RemapNumbers(Value=vec2pt_3.Length, Source=bnd, Target=Domain(0, 1))  # -> Mapped, Clipped
larger = LargerThan(FirstNumber=remap.Mapped, SecondNumber=xy_threshold)  # -> LargerThan, OrEqualTo
larger_2 = LargerThan(FirstNumber=remap_2.Mapped, SecondNumber=z_threshold)  # -> LargerThan, OrEqualTo
dispatch = Dispatch(List=remap.Mapped, DispatchPattern=larger.LargerThan)  # -> ListA, ListB
dispatch_2 = Dispatch(List=remap_2.Mapped, DispatchPattern=larger_2.LargerThan)  # -> ListA, ListB
index = ItemIndex(List=remap.Mapped, Item=dispatch.ListA)
index_2 = ItemIndex(List=remap_2.Mapped, Item=dispatch_2.ListA)
replace = ReplaceItems(List=remap.Mapped, Item="0", Indices=index, Wrap=False)
replace_2 = ReplaceItems(List=remap_2.Mapped, Item="0", Indices=index_2, Wrap=False)
xy_amplitude = Slider(0.66, range=0..1)
z_amplitude = Slider(2.53, range=0..10)
graph_2 = GraphMapper(replace, x0=0, x1=1, y0=0, y1=1, container_name="Bezier", cpx=[0, 0, 1, 1], cpy=[0, 0.4928774834, 0.4985755086, 1])
graph_3 = GraphMapper(replace_2, x0=0, x1=1, y0=0, y1=1, container_name="Bezier", cpx=[0, 0, 1, 1], cpy=[0, 0.5014244914, 0.5042735338, 1])
multiplication = Multiplication(A=graph_3, B=z_amplitude, C=graph)
multiplication_2 = Multiplication(A=graph_2, B=xy_amplitude)
expression = Expression(x=graph, Expression="x*2*π")

# ---- group: MultiPipe
line_2 = Line(dam_2)
end = EndPoints(Curve=line_2)  # -> Start, End
duppt = RemoveDuplicatePts(Points=end.End, Tolerance=0.01)
dom = ConstructDomain(DomainStart=Slider(0.3, range=0..1), DomainEnd=Slider(0.01, range=0..1))
dist = Distance(PointA=eval.Point, PointB=duppt)
bnd_2 = Bounds(Numbers=dist)
remap_3 = RemapNumbers(Value=dist, Source=bnd_2, Target=dom)  # -> Mapped, Clipped
mp = MultiPipe(
    Curves=line_2,
    NodeSize=remap_3.Mapped,
    SizePoints=duppt,
    EndOffset=Slider(0.5, range=0..1),
    StrutSize=Slider(0.5, range=0..1),
    Segment=0,
    KinkAngle=0.6,
    CubeFit=0,
    Caps="1")
rotate = Rotate(Geometry=mp, Angle=expression, Plane=PlaneXY(0, 0, 0))  # -> Geometry, Transform
shader = Shader({diffuse=RGB(255, 219, 0), emission=RGB(0, 0, 0), shine=0.6638327026, specular=RGB(169, 169, 169), transparency=0})
preview = CustomPreview(Geometry=rotate.Geometry, Material=shader)

# ----
amp = Amplitude(Vector=vec2pt_3.Vector, Amplitude=multiplication_2)
devec = DeconstructVector(Vector=amp)  # -> XComponent, YComponent, ZComponent
vec = VectorXYZ(XComponent=devec.XComponent, YComponent=devec.YComponent, ZComponent=multiplication)  # -> Vector, Length
move = Move(Geometry=demesh.Vertices, Motion=vec.Vector)  # -> Geometry, Transform
match = MatchTree(Tree=move.Geometry, Guide=demesh.Faces)
conmesh = ConstructMesh(Vertices=match, Faces=demesh.Faces)
rotate_2 = Rotate(Geometry=conmesh, Angle=expression, Plane=PlaneXY(0, 0, 0))  # -> Geometry, Transform
wbloop = WeaverbirdsLoopSubdivision(MeshCurves=rotate_2.Geometry, Level=Slider(3, range=0..5), SmoothNakedEdges=1)
shader_2 = Shader({diffuse=RGB(205, 246, 244), emission=RGB(0, 0, 0), shine=0.2451076508, specular=RGB(53, 53, 53), transparency=0})
preview_2 = CustomPreview(Geometry=wbloop, Material=shader_2)
