# Grasshopper definition crvToG-code.gh (Grasshopper 1.0.7)

crv_bold = Curve(<curve referenced from the Rhino model>)
crv_fine = Curve([<curve referenced from the Rhino model> x13])

# ---- group: Stroke height
number_slider = Slider(1, range=0..10)
number_slider_2 = Slider(0, range=0..10)
number_slider_3 = Slider(0.3, range=0..10)

# ----
vec2pt = Vector2Pt(PointA="0,0,0", PointB="75,75,0", Unitize=False)  # -> Vector, Length
move = Move(Geometry=crv_bold, Motion=vec2pt.Vector)  # -> Geometry, Transform
move_2 = Move(Geometry=crv_fine, Motion=vec2pt.Vector)  # -> Geometry, Transform
resolution = Slider(1, range=0..10)
len = Length(Curve=move.Geometry)
len_2 = Length(Curve=move_2.Geometry)
multiplication = Multiplication(A=len, B=resolution)
multiplication_2 = Multiplication(A=len_2, B=resolution)
divide = DivideCurve(Curve=move.Geometry, Count=multiplication, Kinks=False)  # -> Points, Tangents, Parameters
range = Range(Domain=Domain(0, 1), Steps=multiplication)
divide_2 = DivideCurve(Curve=move_2.Geometry, Count=multiplication_2, Kinks=False)  # -> Points, Tangents, Parameters
range_2 = Range(Domain=Domain(0, 1), Steps=multiplication_2)
graph = GraphMapper(range_2, x0=0, x1=1, y0=0, y1=1, container_name="Bezier", cpx=[0, 0.2420720607, 0.75, 1], cpy=[0, 0.7483052015, 0.75, 0])
graph_2 = GraphMapper(range, x0=0, x1=1, y0=0, y1=1, container_name="Bezier", cpx=[0, 0.2420720607, 0.75, 1], cpy=[0, 0.7483052015, 0.75, 0])
# G-code generator for Fudepen
dom = ConstructDomain(DomainStart=number_slider, DomainEnd=number_slider_3)
dom_2 = ConstructDomain(DomainStart=number_slider, DomainEnd=number_slider_2)
bnd = Bounds(Numbers=graph)
bnd_2 = Bounds(Numbers=graph_2)
remap = RemapNumbers(Value=graph, Source=bnd, Target=dom)  # -> Mapped, Clipped
remap_2 = RemapNumbers(Value=graph_2, Source=bnd_2, Target=dom_2)  # -> Mapped, Clipped
Z = UnitZ(Factor=remap.Mapped)
Z_2 = UnitZ(Factor=remap_2.Mapped)
move_3 = Move(Geometry=divide_2.Points, Motion=Z)  # -> Geometry, Transform
move_4 = Move(Geometry=divide.Points, Motion=Z_2)  # -> Geometry, Transform
nurbs = NurbsCurve(Vertices=move_4.Geometry, Degree=3, Periodic=False)  # -> flatten(Curve), Length, Domain
nurbs_2 = NurbsCurve(Vertices=move_3.Geometry, Degree=3, Periodic=False)  # -> flatten(Curve), Length, Domain

# ---- group: Drawing G-code / Up to prevent from scratching
number_slider_4 = Slider(5, range=0..10)

# ---- group: Drawing G-code / move base plane to Z
number_slider_5 = Slider(1, range=0..5)

# ----
progress = Slider(1, range=0..1)

# ---- group: Drawing G-code
crv = Curve(flatten([nurbs.Curve, nurbs_2.Curve]))
divlength = DivideLength(Curve=crv, Length=Slider(0.4, range=0..2))  # -> simplify(Points), Tangents, Parameters
Z_3 = UnitZ(Factor=number_slider_4)
item = ListItem(List=divlength.Points, Index=0, Wrap=True)
item_2 = ListItem(List=divlength.Points, Index="-1", Wrap=True)
move_5 = Move(Geometry=item, Motion=Z_3)  # -> Geometry, Transform
move_6 = Move(Geometry=item_2, Motion=Z_3)  # -> Geometry, Transform
ins = InsertItems(List=divlength.Points, Item=move_5.Geometry, Indices="0", Wrap=True)  # -> simplify(List)
ins_2 = InsertItems(List=ins, Item=move_6.Geometry, Indices="-1", Wrap=True)  # -> simplify(List)
Z_4 = UnitZ(Factor=number_slider_5)
move_7 = Move(Geometry=ins_2, Motion=Z_4)  # -> Geometry, Transform
flatten = FlattenTree(Tree=move_7.Geometry, Path="{0}")
number_slider_6 = Slider(4, range=0..10)
pdecon = Deconstruct(Point=flatten)  # -> XComponent, YComponent, ZComponent
eval = Evaluate(F="Round(x,y)", x=pdecon.XComponent, y=number_slider_6)
eval_2 = Evaluate(F="Round(x,y)", x=pdecon.YComponent, y=number_slider_6)
eval_3 = Evaluate(F="Round(x,y)", x=pdecon.ZComponent, y=number_slider_6)
f_speed_mm_min = Slider(4000, range=0..5000)
concat = Concatenate(FragmentA="G1", FragmentC=" X", FragmentD=eval, FragmentE=" Y", FragmentF=eval_2, FragmentG=" Z", FragmentH=eval_3)
concat_2 = Concatenate(FragmentA="G1 F", FragmentB=f_speed_mm_min)
merge = Merge(
    Data1="M82 ;absolute extrusion mode",
    Data2="G92 ;set position",
    Data3=concat_2,
    Data4="G1 Z1.0 F3000",
    Data5=concat,
    Data6="G1 Z10 F1000",
    Data7="G1 X0 Y180 Z90 F1000")
panel = Panel(merge)

# ----
lng = ListLength(List=flatten)
multiplication_3 = Multiplication(A=lng, B=progress)
split = SplitList(List=flatten, Index=multiplication_3)  # -> ListA, ListB

# ---- group: Tool path
pline = PolyLine(Vertices=split.ListA, Closed=False)

# ---- group: Fude-pen dsiplay
number_slider_7 = Slider(9, range=0..10)
item_3 = ListItem(List=split.ListA, Index="-1", Wrap=True)
Z_5 = UnitZ(Factor=number_slider_7)
neg = Negative(Value=number_slider_7)
move_8 = Move(Geometry=item_3, Motion=Z_5)  # -> Geometry, Transform
cone = Cone(Base=move_8.Geometry, Radius=Slider(3, range=0..10), Length=neg)  # -> Cone, Tip
cap = CapHoles(Brep=cone.Cone)
preview = CustomPreview(Geometry=cap, Material=ColourSwatch(SwatchColor=RGB(61, 73, 82)))

# ---- group: Height display
pdecon_2 = Deconstruct(Point=split.ListA)  # -> XComponent, YComponent, ZComponent
bnd_3 = Bounds(Numbers=pdecon_2.ZComponent)
remap_3 = RemapNumbers(Value=pdecon_2.ZComponent, Source=bnd_3, Target="0 to 1")  # -> Mapped, Clipped
gradient = Gradient(
    LowerLimit=0,
    UpperLimit=1,
    Parameter=remap_3.Mapped,
    stops=[0: RGB(0, 0, 0), 0.104: RGB(193, 208, 255), 1: RGB(105, 149, 210)])
cloud = CloudDisplay(Points=split.ListA, Colours=gradient, Size=Slider(0.4, range=0..1), SpriteType=1)

# ---- group: G-code display
item_4 = ListItem(List=concat, Index=multiplication_3, Wrap=True)
panel_2 = Panel(item_4)
xy = XYPlane(Origin="60,145,0")
tag = TextTag3D(Location=xy, Text=item_4, Size=Slider(2, range=0..10), Colour=ColourSwatch(SwatchColor=RGB(0, 0, 0)), Justification=7)
